# Dynamo graph BoqExportToXLS.dyn (Dynamo 2.16.1.2727)

string = StringInput("BoqExportToXLS.py")
file_from_path = FileObject(path=string)
readText = FileSystem.ReadText(file=file_from_path)
path = CodeBlock(path=file_from_path) { path; }
reload = BoolSelector(false)

# group: BOQ Info
# BOQ Info
BOQ_Name = StringInput("BER-GF-SE-CP-00-SH-E-TSLA-8002-09")
rev_number = IntegerSlider(0, range=0..5000 step 1)
rev_seq_n = IntegerSlider(744, range=0..5000 step 1)
elem_filter_name = StringInput("Phase 1b (50GWh)")

code_block = CodeBlock(BOQ_Name=BOQ_Name, rev_num=rev_number, rev_seq=rev_seq_n, elem_filter=elem_filter_name) { BOQ_Name; rev_num; rev_seq; elem_filter; }

# group: Save To
# Save to
elem_filter_name_2 = StringInput("C:\05 TEMP\PrintTest")

code_block_2 = CodeBlock(path=elem_filter_name_2) { path; }
python_script_from_string = PythonStringNode(script=readText, IN[0]=path, IN[1]=reload, IN[2]=code_block.BOQ_Name, IN[3]=code_block.rev_num, IN[4]=code_block.rev_seq, IN[5]=code_block.elem_filter, IN[6]=code_block_2)  # CPython3
