# Dynamo graph CreateBoardByPreset.dyn (Dynamo 2.16.1.2727)

string = StringInput("CreateBoardByPreset.py")
file_from_path = FileObject(path=string)
readText = FileSystem.ReadText(file=file_from_path)
reload = BoolSelector(true)
presets = CodeBlock()
# ---------- presets.designscript (23 lines) ----------
"3A_sub";
"3B_sub";
"2A";
"2C";
"2E_main";
"2E_sub";
"2E1_main";
"2E1_sub";
"2ET";
"2H";
"2I";
"2J_main";
"2J_sub";
"2R_main";
"2R_sub";
"2R2_main";
"2R2_sub";
"2S_main";
"2S_sub";
"2T_main";
"2T_sub";
"2U_main";
"2U_sub";
# ----------------------------------------
list_create = List.Create(item0=presets.out0, item1=presets.out1, item2=presets.out2, item3=presets.out3, item4=presets.out4, item5=presets.out5, item6=presets.out6, item7=presets.out7, item8=presets.out8, item9=presets.out9, item10=presets.out10, item11=presets.out11, item12=presets.out12, item13=presets.out13, item14=presets.out14, item15=presets.out15, item16=presets.out16, item17=presets.out17, item18=presets.out18, item19=presets.out19, item20=presets.out20, item21=presets.out21, item22=presets.out22)
integer_slider = IntegerSlider(19, range=0..100 step 1)  # graph input
code_block = CodeBlock(t=integer_slider) { t-1; }
getItemAtIndex = List.GetItemAtIndex(list=list_create, index=code_block)
python_script_from_string = PythonStringNode(script=readText, IN[0]=file_from_path, IN[1]=reload, IN[2]=getItemAtIndex)  # CPython3
