# Dynamo graph EmLight_UpdateTags.dyn (Dynamo 2.3.2.15696)

string = StringInput("EmLight_UpdateTags.py")  # graph input
file_from_path = FileObject(path=string)
readText = FileSystem.ReadText(file=file_from_path)
reload = BoolSelector(false)
calc_by_panel = BoolSelector(false)  # graph input
or_select_first_element_of = DSModelElementSelection()  # "Or select first element of circuit"; 1 picked in the model
python_script_from_string = PythonStringNode(script=readText, IN[0]=file_from_path, IN[1]=reload, IN[2]=calc_by_panel, IN[3]=or_select_first_element_of)

# group: Select panel
right_panel = DSModelElementSelection()  # 1 picked in the model
left_panel = DSModelElementSelection()  # 1 picked in the model
