# Dynamo graph FindElementsInElSys.dyn (Dynamo 2.13.1.3887)

string = StringInput("FindElementsInElSys.py")  # graph input
file_from_path = FileObject(path=string)
readText = FileSystem.ReadText(file=file_from_path)
reload = BoolSelector(false)
calc_all = BoolSelector(false)  # graph input
python_script_from_string = PythonStringNode(script=readText, IN[0]=file_from_path, IN[1]=reload, IN[2]=calc_all)  # IronPython2; unwired: IN[3]
