# Dynamo graph MoveCircuitsByScheduleNumber.dyn (Dynamo 2.3.0.5885)

string = StringInput("MoveCircuitsByScheduleNumber.py")
file_from_path = FileObject(path=string)
readText = FileSystem.ReadText(file=file_from_path)
reload = BoolSelector(true)
copyFrom = DSModelElementSelection()  # nothing selected; graph input
copyTo = DSModelElementSelection()  # nothing selected; graph input
start = IntegerSlider(2, range=2..120 step 1)  # graph input
end = IntegerSlider(2, range=2..120 step 1)  # graph input
python_script_from_string = PythonStringNode(script=readText, IN[0]=file_from_path, IN[1]=reload, IN[2]=copyFrom, IN[3]=copyTo, IN[4]=start, IN[5]=end)
