# Dynamo graph ReadDataCircuitWriteToParam.dyn (Dynamo 2.3.0.5885)

string = StringInput("ReadDataCircuitWriteToParam.py")  # graph input
file_from_path = FileObject(path=string)
readText = FileSystem.ReadText(file=file_from_path)
reload = BoolSelector(true)
calc_all = BoolSelector(true)  # graph input
test_element = DSModelElementSelection()  # 1 picked in the model
python_script_from_string = PythonStringNode(script=readText, IN[0]=file_from_path, IN[1]=reload, IN[2]=calc_all, IN[3]=test_element)
