# Dynamo graph SingleLineDiagramm.dyn (Dynamo 2.13.1.3887)

string = StringInput("SingleLineDiagramm.py")  # graph input
file_from_path = FileObject(path=string)
readText = FileSystem.ReadText(file=file_from_path)

# group: Reload
# Reload
reload = BoolSelector(true)

panel = DSModelElementSelection()  # 1 picked in the model; graph input
object_on_view = DSModelElementSelection()  # 1 picked in the model; graph input
update_existing_tree_true = BoolSelector(true)
python_script_from_string = PythonStringNode(script=readText, IN[0]=file_from_path, IN[1]=reload, IN[2]=panel, IN[3]=object_on_view, IN[4]=update_existing_tree_true)  # CPython3
